# Dynamo graph bugreport.dyn (Dynamo 0.8.0.950)

code_block = CodeBlock()
# ---------- code_block.designscript (14 lines) ----------
arc = 360.0 / 14.0;
theta1 = 0..360..arc;
theta2 = theta1 + arc/2.0;
theta3 = theta1 + arc;
r1 = 120;
r2 = 140;
p1 = Point.ByCoordinates(r1 * Math.Cos(theta1), r1 * Math.Sin(theta1), 0);
p2 = Point.ByCoordinates(r2 * Math.Cos(theta2), r2 * Math.Sin(theta2), 0);
p3 = Point.ByCoordinates(r1 * Math.Cos(theta3), r1 * Math.Sin(theta3), 0);
a = Arc.ByThreePoints(p1, p2, p3);
// change the 0 here to a nonzero value, then all the sweeps work
plane = Plane.ByOriginNormal(p2, Vector.ByCoordinates(p3.X-p1.X, p3.Y-p1.Y, 0));
profile = Rectangle.ByWidthHeight(plane, 5, 5);
solid = Solid.BySweep(profile, a);
# ----------------------------------------
