# Dynamo graph spirograph.dyn (Dynamo 0.8.0.950)

outer_ring_radius = DoubleSlider(57.98, range=1..500 step 0.01)
gear_radius = DoubleSlider(72.13, range=1..500 step 0.01)
pen_offset = DoubleSlider(108.92, range=0..250 step 0.01)
step_size = DoubleSlider(0.04, range=0.001..0.2 step 0.001)
epicycloid = BoolSelector(true)
spirograph = Python(IN[0]=outer_ring_radius, IN[1]=gear_radius, IN[2]=pen_offset, IN[3]=step_size, IN[4]=epicycloid)
# ---------- spirograph.python (63 lines) ----------
import clr
clr.AddReference('ProtoGeometry')
from Autodesk.DesignScript.Geometry import *

import sys
sys.path.append(r'C:\Program Files (x86)\IronPython 2.7\Lib')

#The inputs to this node will be stored as a list in the IN variable.
dataEnteringNode = IN

import math
import random

PI = 3.14159
out_points = []
R = float(IN[0])
r = float(IN[1])
p = float(IN[2])
step = float(IN[3])
epicycloid = bool(IN[4])


def jitter():
	r = random.random() - 0.5
	return r * 0.00002

def seq(start, stop, step=1):
    n = int(round((stop - start)/step))
    if n > 1:
        return([start + step*i for i in range(n+1)])
    else:
        return([])

def hypocycloidPoint(R, r, p, t):
	a = R - r
	b = r/R * t
	c = (1 - r/R) * t
	x = a * math.cos(b) - p * math.cos(c)
	y = a * math.sin(b) + p * math.sin(c)
	return Point.ByCoordinates(x, y)
	
	
def epicycloidPoint(R, r, p, t):
	a = R + r
	b = r/R * t
	c = (1 + r/R) * t
	x = a * math.cos(b) - p * math.cos(c)
	y = a * math.sin(b) + p * math.sin(c)
	return Point.ByCoordinates(x, y)

def hypocycloidLine(R, r, p, t1, t2):
	return Line.ByStartPointEndPoint(hypocycloidPoint(R, r, p, t1), hypocycloidPoint(R, r, p, t2))


def epicycloidLine(R, r, p, t1, t2):
	return Line.ByStartPointEndPoint(epicycloidPoint(R, r, p, t1), epicycloidPoint(R, r, p, t2))

for t in seq(0 * PI, 39.98 * PI, step):
	#out_points.Add(epicycloidPoint(R, r, p, t) if epicycloid else hypocycloidPoint(R, r, p, t))
	out_points.Add(epicycloidLine(R, r, p, t, t + step) if epicycloid else hypocycloidLine(R, r, p, t, t + step))
	
#Assign your output to the OUT variable
OUT = out_points
# ----------------------------------------
outer_ring_radius_2 = DoubleSlider(205.82, range=1..500 step 0.01)
gear_radius_2 = DoubleSlider(88.2, range=1..500 step 0.01)
pen_offset_2 = DoubleSlider(34.33, range=0..250 step 0.01)
step_size_2 = DoubleSlider(0.141, range=0.001..0.2 step 0.001)
epicycloid_2 = BoolSelector(false)
code_block = CodeBlock { offset = 0.75; }
spirograph_2 = Python(IN[0]=outer_ring_radius_2, IN[1]=gear_radius_2, IN[2]=pen_offset_2, IN[3]=step_size_2, IN[4]=epicycloid_2, IN[5]=code_block)
# ---------- spirograph_2.python (64 lines) ----------
import clr
clr.AddReference('ProtoGeometry')
from Autodesk.DesignScript.Geometry import *

import sys
sys.path.append(r'C:\Program Files (x86)\IronPython 2.7\Lib')

#The inputs to this node will be stored as a list in the IN variable.
dataEnteringNode = IN

import math
import random

PI = 3.14159
out_points = []
R = float(IN[0])
r = float(IN[1])
p = float(IN[2])
step = float(IN[3])
epicycloid = bool(IN[4])
offset = float(IN[5])


def jitter():
	r = random.random() - 0.5
	return r * 0.00002

def seq(start, stop, step=1):
    n = int(round((stop - start)/step))
    if n > 1:
        return([start + step*i for i in range(n+1)])
    else:
        return([])

def hypocycloidPoint(R, r, p, t):
	a = R - r
	b = r/R * t + offset
	c = (1 - r/R) * t + offset
	x = a * math.cos(b) - p * math.cos(c)
	y = a * math.sin(b) + p * math.sin(c)
	return Point.ByCoordinates(x, y)
	
	
def epicycloidPoint(R, r, p, t):
	a = R + r
	b = r/R * t + offset
	c = (1 + r/R) * t + offset
	x = a * math.cos(b) - p * math.cos(c)
	y = a * math.sin(b) + p * math.sin(c)
	return Point.ByCoordinates(x, y)

def hypocycloidLine(R, r, p, t1, t2):
	return Line.ByStartPointEndPoint(hypocycloidPoint(R, r, p, t1), hypocycloidPoint(R, r, p, t2))


def epicycloidLine(R, r, p, t1, t2):
	return Line.ByStartPointEndPoint(epicycloidPoint(R, r, p, t1), epicycloidPoint(R, r, p, t2))

for t in seq(0 * PI, 39.98 * PI, step):
	#out_points.Add(epicycloidPoint(R, r, p, t) if epicycloid else hypocycloidPoint(R, r, p, t))
	out_points.Add(epicycloidLine(R, r, p, t, t + step) if epicycloid else hypocycloidLine(R, r, p, t, t + step))
	
#Assign your output to the OUT variable
OUT = out_points
# ----------------------------------------
join = List.Join(spirograph, spirograph_2)
code_block_2 = CodeBlock { width = 0.0007; depth = 4; }
polygonize = Python(IN[0]=join, IN[1]=code_block_2.width)
# ---------- polygonize.python (35 lines) ----------
import clr
clr.AddReference('ProtoGeometry')
from Autodesk.DesignScript.Geometry import *

import sys
sys.path.append(r'C:\Program Files (x86)\IronPython 2.7\Lib')

#The inputs to this node will be stored as a list in the IN variable.
dataEnteringNode = IN

import math
import random

PI = 3.14159
out_polygons = []
lines = IN[0]
width = float(IN[1])

def getCornersForPoint(pt, normal):
	d = math.pow(math.pow(pt.X, 2) + math.pow(pt.Y, 2), 0.8) * width
	v = normal.Cross(Vector.ByCoordinates(0, 0, 1)).Normalized().Scale(d)
	return [pt.Add(v), pt.Subtract(v)]

for index in range(0, len(lines), 1):
	line = lines[index]
	nextline = lines[index + 1 if index < len(lines) - 1 else len(lines) - 1]
	prevline = lines[index - 1 if index > 0 else 0]
	n1 = Vector.ByTwoPoints(prevline.StartPoint, line.EndPoint)
	n2 = Vector.ByTwoPoints(line.StartPoint, nextline.EndPoint)
	out_polygons.Add(Polygon.ByPoints(getCornersForPoint(line.StartPoint, n1) + [p for p in reversed(getCornersForPoint(line.EndPoint, n2))]))
	#p = getCornersForPoint(line.StartPoint, n1)
	#out_polygons.Add(Line.ByStartPointEndPoint(p[0], p[1]))

#Assign your output to the OUT variable
OUT = out_polygons
# ----------------------------------------
extrudeAsSolid = Curve.ExtrudeAsSolid(polygonize, code_block_2.depth)
