# Dynamo graph spirograph_node.dyn (Dynamo 0.8.0.950)

code_block = CodeBlock { depth = 5; }
extrudeAsSolid = Curve.ExtrudeAsSolid(arg1=code_block)
XY = Plane.XY()
number_slider = DoubleSlider(-4, range=-180..180 step 1)
rotate = Geometry.Rotate(arg1=XY, arg2=number_slider)
outer_ring_radius = DoubleSlider(57.98, range=1..500 step 0.01)
gear_radius = DoubleSlider(72.13, range=1..500 step 0.01)
pen_offset = DoubleSlider(108.92, range=0..250 step 0.01)
step_size = DoubleSlider(0.055, range=0.001..0.2 step 0.001)
epicycloid = BoolSelector(true)
asLines = Spirograph.Spirograph.AsLines(outer_ring_radius, gear_radius, pen_offset, step_size, epicycloid)
min_width = DoubleSlider(0.9, range=0.1..10 step 0.05)
max_width = DoubleSlider(3.05, range=0.1..10 step 0.05)
code_block_2 = CodeBlock(R=outer_ring_radius, r=gear_radius, p=pen_offset) { mindist = R; maxdist = R + r + p; }
strokeLinesWithPolygons = Spirograph.Spirograph.StrokeLinesWithPolygons(asLines, min_width, max_width, code_block_2.mindist, code_block_2.maxdist)
