# Dynamo graph spirograph_node_svg.dyn (Dynamo 0.8.0.950)

code_block = CodeBlock { depth = 5; }
outer_ring_radius = DoubleSlider(57.98, range=1..500 step 0.01)
gear_radius = DoubleSlider(72.03, range=1..500 step 0.01)
pen_offset = DoubleSlider(108.92, range=0..250 step 0.01)
epicycloid = BoolSelector(true)
step_size = DoubleSlider(4680, range=10..10000 step 10)
startParam = DoubleSlider(-14.47, range=-14.7..-13.72 step 0.01)
endParam = DoubleSlider(111.7688, range=111.764..111.77 step 0.0001)
asLines = Spirograph.Spirograph.AsLines(outer_ring_radius, gear_radius, pen_offset, epicycloid, step_size, startParam, endParam)
min_width = DoubleSlider(0.9, range=0.1..10 step 0.05)
max_width = DoubleSlider(3.65, range=0.1..10 step 0.05)
code_block_2 = CodeBlock(R=outer_ring_radius, r=gear_radius, p=pen_offset) { mindist = R; maxdist = R + r + p; }
strokeLinesWithPolygons = Spirograph.Spirograph.StrokeLinesWithPolygons(asLines, min_width, max_width, code_block_2.mindist, code_block_2.maxdist)
code_block_3 = CodeBlock { "d:\\temp\\test.svg"; "d:\\temp\\arcs.svg"; 1.0; }
writePolygonsToSVG = Spirograph.Spirograph.WritePolygonsToSVG(strokeLinesWithPolygons, code_block_3.out0)
code_block_4 = CodeBlock()
# ---------- code_block_4.designscript (13 lines) ----------
arc = 360.0 / 14.0;
offset = 19.0;
theta1 = offset..360+offset..arc;
theta2 = theta1 + arc/2.0;
theta3 = theta1 + arc;
r1 = 120;
r2 = 140;
p1 = Point.ByCoordinates(r1 * Math.Cos(theta1), r1 * Math.Sin(theta1), 0);
p2 = Point.ByCoordinates(r2 * Math.Cos(theta2), r2 * Math.Sin(theta2), 0);
p3 = Point.ByCoordinates(r1 * Math.Cos(theta3), r1 * Math.Sin(theta3), 0);
a = Arc.ByThreePoints(p1, p2, p3);
plane = Plane.ByOriginNormal(Point.ByCoordinates(p2.X, p2.Y, -2.5), Vector.ByCoordinates(p3.X-p1.X, p3.Y-p1.Y, 0.001));
profile = Rectangle.ByWidthHeight(plane, 5, 7);
# ----------------------------------------
writeArcsToSvg = Spirograph.Spirograph.WriteArcsToSvg(code_block_4.a, code_block_3.out2, code_block_3.out1)
